% Simulink data dictionary example.sldd

CAN_EC_Status_3_t = Simulink.Bus()
  IsMsgAvl: boolean  % Is Message Available
  EC3_Bus_Off_Fault: boolean  % CAN communication bus busoff fault  protection
  EC3_CAN_Communication_lost: boolean  % CAN communication signal loss protection
  EC3_Current_Flodback: boolean  % Output current hysteresis protection
  EC3_DC_Over_Voltage: boolean  % DC voltage overvoltage protection
  EC3_DC_Under_Voltage: boolean  % Low voltage protection of DC voltage
  EC3_DC_Voltage_Low: boolean  % DC undervoltage protection
  EC3_DSP_High_Temperature: boolean  % DSP overtemperature protection
  EC3_Fault_Limit_Lockout: boolean  % Fault override self-locking protection
  EC3_IGBT_High_Temperature: boolean  % Power device overtemperature protection
  EC3_Inverter_Current_Imbalance: boolean  % Output current three-phase imbalance protection
  EC3_Inverter_Over_Current_Fault: boolean  % Output overcurrent protection
  EC3_Inverter_Over_Temp_Fault: boolean  % High temperature protection of power devices
  EC3_Inverter_Temperature_Open: boolean  % Open circuit protection of temperature detection sensor
  EC3_Lost_Phase_Fault: boolean  % Lost Phase protection
  EC3_Micro_Electronic_Fault: boolean  % Microelectronics failure
  EC3_Over_Speed_Fault: boolean  % Motor control Over Speed protection
  EC3_Temp_Floadback: boolean  % Not enabled

CAN_EC_Status_2_t = Simulink.Bus()
  IsMsgAvl: boolean  % Is Message Available
  EC2_DC_Current: single  % DC Current feedback from compressor  data/8
  EC2_Phase_Current: single  % Phase Current feedback from compressor  data/256

CAN_EC_Status_1_t = Simulink.Bus()
  IsMsgAvl: boolean  % Is Message Available
  EC1_Board_Temp: single  % Temperature sensor measured value data/256
  EC1_Compressor_Running_Speed: single  % Actual speed feedback from compressor
  EC1_DC_Bus_Voltage: single  % DC Voltage sensor measured value  data/16
  EC1_MOS_Temp: single  % Temperature sensor measured value data/256

CAN_AC_Message_t = Simulink.Bus()
  IsMsgAvl: boolean  % Is Message Available
  AC_Enable_Disable_Compressor: uint16  % 1=on 0=off
  AC_Set_Speed: uint16  % Target speed